# Dynamo graph Example CompoundStructure.dyn (Dynamo 1.3.0.875)

# group: INPUTS
wall_types = WallTypes("Interior - 4 7/8\" Partition (1-hr)")
number_slider = DoubleSlider(1, range=0..5 step 1)
number_from_feet_and_inches = LengthFromString(0.3048)

# group: OPERATIONS
fromWallType = Synthetic.Revit.CompoundStructure.FromWallType(wall_types)
setLayerWidth = Synthetic.Revit.CompoundStructure.SetLayerWidth(fromWallType, number_slider, number_from_feet_and_inches)
toWallType = Synthetic.Revit.CompoundStructure.ToWallType(wall_types, setLayerWidth)

# group: MONITOR
watch = Watch(fromWallType)

# group: MONITOR
getLayers = Synthetic.Revit.CompoundStructure.GetLayers(setLayerWidth)
watch_2 = Watch(getLayers)
